# Dynamo graph Dynamo Model V1.0.dyn (Dynamo 2.6.1.8786)
# packages: Clockwork for Dynamo 2.x 2.3.0, bimorphNodes 4.0.0, archi-lab.net 2022.212.2722

# group: 1 Internal Wall Delete
watch = Watch()  # unwired: arg0
categories = Categories("OST_Walls")
all_elements_of_category = ElementsOfCategory(Category=categories)
elementType = Element.ElementType(element=all_elements_of_category)
function = Custom[FamilyType.Function](familyType=elementType)  # package Clockwork for Dynamo 2.x; Retrieves the Function property of a given family type (if it has that property)
string = StringInput("Interior")
eq = function == string
filterByBoolMask = List.FilterByBoolMask(list=all_elements_of_category, mask=eq)
delete = Element.Delete(element=filterByBoolMask.in)

# group: 8 Excel Path
file_path = Filename("..\Testing & Debugging\Research Model  (Cleaned).xlsm")

# group: 7 Schedule to Excel
element_types = ElementTypes("ViewSchedule")
string_2 = StringInput("Research")
code_block = CodeBlock { 0; }

# group: 6 Doors Schedule Creating
categories_2 = Categories("OST_Doors")
code_block_2 = CodeBlock { "Research_Doors"; }
schedule_type = ScheduleTypes("RegularSchedule")

# group: 5 Level Schedule Creating
categories_3 = Categories("OST_Levels")
code_block_3 = CodeBlock { "Research_Levels"; }
schedule_type_2 = ScheduleTypes("RegularSchedule")

# group: 4 Floor Schedule Creating
categories_4 = Categories("OST_Floors")
code_block_4 = CodeBlock { "Research_Floors"; }
schedule_type_3 = ScheduleTypes("RegularSchedule")

# group: 3 Wall Schedule Creating
categories_5 = Categories("OST_Walls")
code_block_5 = CodeBlock { "Research_Wall"; }
schedule_type_4 = ScheduleTypes("RegularSchedule")

# group: 2 Window schedule creating
categories_6 = Categories("OST_Windows")
code_block_6 = CodeBlock { "Research_Window"; }
schedule_type_5 = ScheduleTypes("RegularSchedule")

# group: Passthrough
passthrough = Custom[Passthrough](passThrough=categories_6, waitFor=delete)  # package Clockwork for Dynamo 2.x; Forces a sequential order of execution. The node wired into the output of the Passthrough node will be executed *after* the node wired into the waitFor input (e.g. important for some Revit operations). The value of the passThrough input will be passed on to the node wired into the output port of the Passthrough node.

# group (continued): 2 Window schedule creating
createSchedule = ScheduleView.CreateSchedule(category=passthrough, name=code_block_6, scheduleType=schedule_type_5)
schedulableFields = ScheduleView.SchedulableFields(scheduleView=createSchedule)
code_block_7 = CodeBlock(x=schedulableFields) { x[0]; x[32]; x[33]; }
code_block_8 = CodeBlock(a=code_block_7.out0, b=code_block_7.out1, c=code_block_7.out2) { [a,b,c]; }
addFields = ScheduleView.AddFields(scheduleView=createSchedule, fields=code_block_8)

# group: Passthrough
passthrough_2 = Custom[Passthrough](passThrough=categories_5, waitFor=addFields)

# group (continued): 3 Wall Schedule Creating
createSchedule_2 = ScheduleView.CreateSchedule(category=passthrough_2, name=code_block_5, scheduleType=schedule_type_4)
schedulableFields_2 = ScheduleView.SchedulableFields(scheduleView=createSchedule_2)
code_block_9 = CodeBlock(x=schedulableFields_2) { x[0]; x[14]; }
code_block_10 = CodeBlock(a=code_block_9.out0, b=code_block_9.out1) { [a,b]; }
addFields_2 = ScheduleView.AddFields(scheduleView=createSchedule_2, fields=code_block_10)

# group: Passthrough
passthrough_3 = Custom[Passthrough](passThrough=categories_4, waitFor=addFields_2)

# group (continued): 4 Floor Schedule Creating
createSchedule_3 = ScheduleView.CreateSchedule(category=passthrough_3, name=code_block_4, scheduleType=schedule_type_3)
schedulableFields_3 = ScheduleView.SchedulableFields(scheduleView=createSchedule_3)
code_block_11 = CodeBlock(x=schedulableFields_3) { x[0]; x[12]; }
code_block_12 = CodeBlock(a=code_block_11.out0, b=code_block_11.out1) { [a,b]; }
addFields_3 = ScheduleView.AddFields(scheduleView=createSchedule_3, fields=code_block_12)

# group: Passthrough
passthrough_4 = Custom[Passthrough](passThrough=categories_3, waitFor=addFields_3)

# group (continued): 5 Level Schedule Creating
createSchedule_4 = ScheduleView.CreateSchedule(category=passthrough_4, name=code_block_3, scheduleType=schedule_type_2)
schedulableFields_4 = ScheduleView.SchedulableFields(scheduleView=createSchedule_4)
code_block_13 = CodeBlock(x=schedulableFields_4) { x[5]; x[10]; }
code_block_14 = CodeBlock(a=code_block_13.out0, b=code_block_13.out1) { [a,b]; }
addFields_4 = ScheduleView.AddFields(scheduleView=createSchedule_4, fields=code_block_14)

# group: Passthrough
passthrough_5 = Custom[Passthrough](passThrough=categories_2, waitFor=addFields_4)

# group (continued): 6 Doors Schedule Creating
createSchedule_5 = ScheduleView.CreateSchedule(category=passthrough_5, name=code_block_2, scheduleType=schedule_type)
schedulableFields_5 = ScheduleView.SchedulableFields(scheduleView=createSchedule_5)
code_block_15 = CodeBlock(x=schedulableFields_5) { x[0]; x[33]; x[34]; }
code_block_16 = CodeBlock(a=code_block_15.out0, b=code_block_15.out1, c=code_block_15.out2) { [a,b,c]; }
addFields_5 = ScheduleView.AddFields(scheduleView=createSchedule_5, fields=code_block_16)

# group: Passthrough
passthrough_6 = Custom[Passthrough](passThrough=element_types, waitFor=addFields_5)

# group (continued): 7 Schedule to Excel
all_elements_of_type = ElementsOfType(element_type=passthrough_6)
name = Element.Name(element=all_elements_of_type)
startsWith = String.StartsWith(str=name, searchFor=string_2)
filterByBoolMask_2 = List.FilterByBoolMask(list=all_elements_of_type, mask=startsWith)
name_2 = Element.Name(element=filterByBoolMask_2.in)
getData = Revit.Schedule.GetData(scheduleView=filterByBoolMask_2.in)
exportExcel = Data.ExportExcel(filePath=file_path, sheetName=name_2, startRow=code_block, startCol=code_block, data=getData)

code_block_window = CodeBlock { "Research_Window"; 2; 3; }

# group: 9 Orientation
categories_7 = Categories("OST_Walls")
categories_8 = Categories("OST_ProjectBasePoint")
code_block_research_wall = CodeBlock { "Research_Wall"; 2; 2; 4; }
categories_9 = Categories("OST_Windows")
code_block_17 = CodeBlock { "Angle to True North"; }

# group: Passthrough
passthrough_7 = Custom[Passthrough](passThrough=categories_7, waitFor=exportExcel)

# group (continued): 9 Orientation
all_elements_of_category_2 = ElementsOfCategory(Category=passthrough_7)
orientation = Custom[Wall.Orientation](wall=all_elements_of_category_2)  # frozen; package Clockwork for Dynamo 2.x; Gets the orientation of a given wall instance (normal of the exterior face of the wall). Will *not* work for walls hosted on mass faces or in-place walls.
exteriorDirection = Custom[Wall.ExteriorDirection](wall=all_elements_of_category_2)  # package archi-lab.net; This node returns exterior direction of the wall as a vector.
data_exportexcel_wall = Data.ExportExcel(filePath=file_path, sheetName=code_block_research_wall.out0, startRow=code_block_research_wall.out1, startCol=code_block_research_wall.out2, data=exteriorDirection)

# group: Passthrough
passthrough_8 = Custom[Passthrough](passThrough=categories_8, waitFor=data_exportexcel_wall)

# group (continued): 9 Orientation
all_elements_of_category_3 = ElementsOfCategory(Category=passthrough_8)
parameters = Element.Parameters(element=all_elements_of_category_3)  # frozen
element_getparametervaluebyname = Element.GetParameterValueByName(element=all_elements_of_category_3, parameterName=code_block_17)  # "Element.GetParameterValueByName (True North)"
data_exportexcel_true_north = Data.ExportExcel(filePath=file_path, sheetName=code_block_research_wall.out0, startRow=code_block_research_wall.out1, startCol=code_block_research_wall.out3, data=element_getparametervaluebyname)

# group (continued): Passthrough
passthrough_9 = Custom[Passthrough](passThrough=categories_9, waitFor=data_exportexcel_true_north)

# group (continued): 9 Orientation
all_elements_of_category_4 = ElementsOfCategory(Category=passthrough_9)
facingOrientation = FamilyInstance.FacingOrientation(familyInstance=all_elements_of_category_4)
data_exportexcel_window_ori = Data.ExportExcel(filePath=file_path, sheetName=code_block_window.out0, startRow=code_block_window.out1, startCol=code_block_window.out2, data=facingOrientation)

data_exportexcel_window_det = Data.ExportExcel(filePath=file_path, sheetName=code_block_window.out0, startRow=code_block_window.out1, startCol=code_block_window.out1)  # unwired: data
