# Dynamo graph Test 2022 Feb 18.dyn (Dynamo 2.6.1.8786)
# packages: Clockwork for Dynamo 2.x 2.3.0, bimorphNodes 4.0.0, archi-lab.net 2022.212.2722

# group: 4 Internal Wall Delete
watch = Watch()  # unwired: arg0
categories = Categories("OST_Walls")
string = StringInput("Interior")

# group: Waiting
boolean = BoolSelector(false)
pause = Thread.Pause()  # unwired: x, msTimeout
passthrough = Custom[Passthrough]()  # package Clockwork for Dynamo 2.x; Forces a sequential order of execution. The node wired into the output of the Passthrough node will be executed *after* the node wired into the waitFor input (e.g. important for some Revit operations). The value of the passThrough input will be passed on to the node wired into the output port of the Passthrough node.; unwired: passThrough, waitFor

parameters = Element.Parameters()  # unwired: element

# group: 11 Excel Path
file_path = Filename("ASHRAE Method\Developing\V 2.0\For 3 Storey Building\Research Model - 3 Storey (Not Cleared).xlsm")

# group: 10 Schedule to Excel
element_types = ElementTypes("ViewSchedule")
string_2 = StringInput("Research")
code_block = CodeBlock { 0; }

# group: 9 Doors Schedule Creating
categories_2 = Categories("OST_Doors")
code_block_2 = CodeBlock { "Research_Doors"; }
schedule_type = ScheduleTypes("RegularSchedule")

# group: 8 Level Schedule Creating
categories_3 = Categories("OST_Levels")
code_block_3 = CodeBlock { "Research_Levels"; }
schedule_type_2 = ScheduleTypes("RegularSchedule")

# group: 7 Floor Schedule Creating
categories_4 = Categories("OST_Floors")
code_block_4 = CodeBlock { "Research_Floors"; }
schedule_type_3 = ScheduleTypes("RegularSchedule")

# group: 6 Wall Schedule Creating
categories_5 = Categories("OST_Walls")
code_block_5 = CodeBlock { "Research_Wall"; }
schedule_type_4 = ScheduleTypes("RegularSchedule")

# group: 5 Window schedule creating
categories_6 = Categories("OST_Windows")
code_block_6 = CodeBlock { "Research_Window"; }
schedule_type_5 = ScheduleTypes("RegularSchedule")

# group: 3 Room & Room tag delete
categories_7 = Categories("OST_Rooms")
categories_8 = Categories("OST_RoomTags")

# group: 2 Room Schedule to Excel
element_types_2 = ElementTypes("ViewSchedule")
string_3 = StringInput("Initial")
code_block_7 = CodeBlock { 0; }

# group: 1 Initial Room Schedule Creation
categories_9 = Categories("OST_Rooms")
string_4 = StringInput("Initial_Room")
schedule_type_6 = ScheduleTypes("RegularSchedule")
createSchedule = ScheduleView.CreateSchedule(category=categories_9, name=string_4, scheduleType=schedule_type_6)
schedulableFields = ScheduleView.SchedulableFields(scheduleView=createSchedule)
code_block_8 = CodeBlock(x=schedulableFields) { x[0]; x[9]; x[18]; }
code_block_9 = CodeBlock(a=code_block_8.out0, b=code_block_8.out1, c=code_block_8.out2) { [a,b,c]; }
addFields = ScheduleView.AddFields(scheduleView=createSchedule, fields=code_block_9)

# group: Passthrough
passthrough_2 = Custom[Passthrough](passThrough=element_types_2, waitFor=addFields)

# group (continued): 2 Room Schedule to Excel
all_elements_of_type = ElementsOfType(element_type=passthrough_2)
name = Element.Name(element=all_elements_of_type)
startsWith = String.StartsWith(str=name, searchFor=string_3)
filterByBoolMask = List.FilterByBoolMask(list=all_elements_of_type, mask=startsWith)
name_2 = Element.Name(element=filterByBoolMask.in)
getData = Revit.Schedule.GetData(scheduleView=filterByBoolMask.in)
exportExcel = Data.ExportExcel(filePath=file_path, sheetName=name_2, startRow=code_block_7, startCol=code_block_7, data=getData)

# group: Passthrough
passthrough_3 = Custom[Passthrough](passThrough=categories_8, waitFor=exportExcel)

code_block_10 = CodeBlock { 5000; }
pause_2 = Thread.Pause(x=passthrough_3, msTimeout=code_block_10)

# group (continued): 3 Room & Room tag delete
all_elements_of_category = ElementsOfCategory(Category=pause_2)
delete = Element.Delete(element=all_elements_of_category)

# group: Passthrough
passthrough_4 = Custom[Passthrough](passThrough=categories_7, waitFor=delete)

# group (continued): 3 Room & Room tag delete
all_elements_of_category_2 = ElementsOfCategory(Category=passthrough_4)
delete_2 = Element.Delete(element=all_elements_of_category_2)

# group: Passthrough
passthrough_5 = Custom[Passthrough](passThrough=categories, waitFor=delete_2)

# group (continued): 4 Internal Wall Delete
all_elements_of_category_3 = ElementsOfCategory(Category=passthrough_5)
elementType = Element.ElementType(element=all_elements_of_category_3)
function = Custom[FamilyType.Function](familyType=elementType)  # package Clockwork for Dynamo 2.x; Retrieves the Function property of a given family type (if it has that property)
eq = function == string
filterByBoolMask_2 = List.FilterByBoolMask(list=all_elements_of_category_3, mask=eq)
delete_3 = Element.Delete(element=filterByBoolMask_2.in)

# group: Passthrough
passthrough_6 = Custom[Passthrough](passThrough=categories_6, waitFor=delete_3)

# group (continued): 5 Window schedule creating
createSchedule_2 = ScheduleView.CreateSchedule(category=passthrough_6, name=code_block_6, scheduleType=schedule_type_5)
schedulableFields_2 = ScheduleView.SchedulableFields(scheduleView=createSchedule_2)
code_block_11 = CodeBlock(x=schedulableFields_2) { x[0]; x[32]; x[33]; }
code_block_12 = CodeBlock(a=code_block_11.out0, b=code_block_11.out1, c=code_block_11.out2) { [a,b,c]; }
addFields_2 = ScheduleView.AddFields(scheduleView=createSchedule_2, fields=code_block_12)

# group: Passthrough
passthrough_7 = Custom[Passthrough](passThrough=categories_5, waitFor=addFields_2)

# group (continued): 6 Wall Schedule Creating
createSchedule_3 = ScheduleView.CreateSchedule(category=passthrough_7, name=code_block_5, scheduleType=schedule_type_4)
schedulableFields_3 = ScheduleView.SchedulableFields(scheduleView=createSchedule_3)
code_block_13 = CodeBlock(x=schedulableFields_3) { x[0]; x[14]; }
code_block_14 = CodeBlock(a=code_block_13.out0, b=code_block_13.out1) { [a,b]; }
addFields_3 = ScheduleView.AddFields(scheduleView=createSchedule_3, fields=code_block_14)

# group: Passthrough
passthrough_8 = Custom[Passthrough](passThrough=categories_4, waitFor=addFields_3)

# group (continued): 7 Floor Schedule Creating
createSchedule_4 = ScheduleView.CreateSchedule(category=passthrough_8, name=code_block_4, scheduleType=schedule_type_3)
schedulableFields_4 = ScheduleView.SchedulableFields(scheduleView=createSchedule_4)
code_block_15 = CodeBlock(x=schedulableFields_4) { x[0]; x[12]; }
code_block_16 = CodeBlock(a=code_block_15.out0, b=code_block_15.out1) { [a,b]; }
addFields_4 = ScheduleView.AddFields(scheduleView=createSchedule_4, fields=code_block_16)

# group: Passthrough
passthrough_9 = Custom[Passthrough](passThrough=categories_3, waitFor=addFields_4)

# group (continued): 8 Level Schedule Creating
createSchedule_5 = ScheduleView.CreateSchedule(category=passthrough_9, name=code_block_3, scheduleType=schedule_type_2)
schedulableFields_5 = ScheduleView.SchedulableFields(scheduleView=createSchedule_5)
code_block_17 = CodeBlock(x=schedulableFields_5) { x[5]; x[10]; }
code_block_18 = CodeBlock(a=code_block_17.out0, b=code_block_17.out1) { [a,b]; }
addFields_5 = ScheduleView.AddFields(scheduleView=createSchedule_5, fields=code_block_18)

# group: Passthrough
passthrough_10 = Custom[Passthrough](passThrough=categories_2, waitFor=addFields_5)

# group (continued): 9 Doors Schedule Creating
createSchedule_6 = ScheduleView.CreateSchedule(category=passthrough_10, name=code_block_2, scheduleType=schedule_type)
schedulableFields_6 = ScheduleView.SchedulableFields(scheduleView=createSchedule_6)
code_block_19 = CodeBlock(x=schedulableFields_6) { x[0]; x[33]; x[34]; }
code_block_20 = CodeBlock(a=code_block_19.out0, b=code_block_19.out1, c=code_block_19.out2) { [a,b,c]; }
addFields_6 = ScheduleView.AddFields(scheduleView=createSchedule_6, fields=code_block_20)

# group: Passthrough
passthrough_11 = Custom[Passthrough](passThrough=element_types, waitFor=addFields_6)

# group (continued): 10 Schedule to Excel
all_elements_of_type_2 = ElementsOfType(element_type=passthrough_11)
name_3 = Element.Name(element=all_elements_of_type_2)
startsWith_2 = String.StartsWith(str=name_3, searchFor=string_2)
filterByBoolMask_3 = List.FilterByBoolMask(list=all_elements_of_type_2, mask=startsWith_2)
name_4 = Element.Name(element=filterByBoolMask_3.in)
getData_2 = Revit.Schedule.GetData(scheduleView=filterByBoolMask_3.in)
exportExcel_2 = Data.ExportExcel(filePath=file_path, sheetName=name_4, startRow=code_block, startCol=code_block, data=getData_2)

passthrough_12 = Custom[Passthrough]()  # unwired: passThrough, waitFor
code_block_window = CodeBlock { "Research_Window"; 2; 3; }

# group: 12 Orientation
categories_10 = Categories("OST_Walls")
categories_11 = Categories("OST_ProjectBasePoint")
code_block_research_wall = CodeBlock { "Research_Wall"; 2; 2; 4; }
categories_12 = Categories("OST_Windows")
code_block_21 = CodeBlock { "Angle to True North"; }

# group: Passthrough
passthrough_13 = Custom[Passthrough](passThrough=categories_10, waitFor=exportExcel_2)

# group (continued): 12 Orientation
all_elements_of_category_4 = ElementsOfCategory(Category=passthrough_13)
orientation = Custom[Wall.Orientation](wall=all_elements_of_category_4)  # frozen; package Clockwork for Dynamo 2.x; Gets the orientation of a given wall instance (normal of the exterior face of the wall). Will *not* work for walls hosted on mass faces or in-place walls.
exteriorDirection = Custom[Wall.ExteriorDirection](wall=all_elements_of_category_4)  # package archi-lab.net; This node returns exterior direction of the wall as a vector.
data_exportexcel_wall = Data.ExportExcel(filePath=file_path, sheetName=code_block_research_wall.out0, startRow=code_block_research_wall.out1, startCol=code_block_research_wall.out2, data=exteriorDirection)

# group: Passthrough
passthrough_14 = Custom[Passthrough](passThrough=categories_11, waitFor=data_exportexcel_wall)

# group (continued): 12 Orientation
all_elements_of_category_5 = ElementsOfCategory(Category=passthrough_14)
parameters_2 = Element.Parameters(element=all_elements_of_category_5)  # frozen
element_getparametervaluebyname = Element.GetParameterValueByName(element=all_elements_of_category_5, parameterName=code_block_21)  # "Element.GetParameterValueByName (True North)"
data_exportexcel_true_north = Data.ExportExcel(filePath=file_path, sheetName=code_block_research_wall.out0, startRow=code_block_research_wall.out1, startCol=code_block_research_wall.out3, data=element_getparametervaluebyname)

# group (continued): Passthrough
passthrough_15 = Custom[Passthrough](passThrough=categories_12, waitFor=data_exportexcel_true_north)

# group (continued): 12 Orientation
all_elements_of_category_6 = ElementsOfCategory(Category=passthrough_15)
facingOrientation = FamilyInstance.FacingOrientation(familyInstance=all_elements_of_category_6)
data_exportexcel_window_ori = Data.ExportExcel(filePath=file_path, sheetName=code_block_window.out0, startRow=code_block_window.out1, startCol=code_block_window.out2, data=facingOrientation)

parameters_3 = Element.Parameters(element=all_elements_of_category_6)  # frozen
code_block_22 = CodeBlock { "Area"; }  # frozen
element_getparametervaluebyname_2 = Element.GetParameterValueByName(element=all_elements_of_category_6, parameterName=code_block_22)  # "Element.GetParameterValueByName (Window)"
data_exportexcel_window_det = Data.ExportExcel(filePath=file_path, sheetName=code_block_window.out0, startRow=code_block_window.out1, startCol=code_block_window.out1, data=element_getparametervaluebyname_2)
code_block_23 = CodeBlock { "Window Inset"; }  # frozen
element_getparametervaluebyname_3 = Element.GetParameterValueByName(element=all_elements_of_category_6, parameterName=code_block_23)  # "Element.GetParameterValueByName (Window)"
